# Dynamo custom node String.FindRegularExpression.dyf (Dynamo 1.3.2.2480)
# category: Clockwork.Core.String.Actions
# Returns all occurences of a regular expression within a string (or list of strings). The syntax for regular expressions is explained at
# http://ironpython-test.readthedocs.org/en/latest/howto/regex.html

str = Input(str : string)
RegEx = Input(RegEx : string)
create = List.Create(str)
flatten = Flatten(create)
python_script = Python(IN[0]=RegEx, IN[1]=flatten)
# ---------- python_script.python (13 lines) ----------
import clr
import re

regexstring = IN[0]
regexlist = IN[1]
elementlist = list()
thisexp = re.compile(regexstring)
for item in regexlist:
	try:
		elementlist.append(thisexp.findall(item))
	except:
		elementlist.append(list())
OUT = elementlist
# ----------------------------------------
python_script_2 = Python(IN[0]=str, IN[1]=python_script)
# ---------- python_script_2.python (4 lines) ----------
check = IN[0]
items = IN[1]
if isinstance(check, (list)): OUT = items
else: OUT = items[0]
# ----------------------------------------
seq = Output(python_script_2)
watch = Watch(python_script)
watch_2 = Watch(flatten)
watch_3 = Watch(create)
watch_4 = Watch(python_script_2)
