# Dynamo custom node export ifc differences into excel2.dyf (Dynamo 1.3.2.2480)
# category: Bakery
# export ifc differences into excel

# group: getting the old and new IFC
list = Input()
index_new = Input()
getItemAtIndex = List.GetItemAtIndex(list=list, index=index_new)
watch = Watch(getItemAtIndex)
code_block = CodeBlock(newIFC=watch) { newIFC; }
index_old = Input()
getItemAtIndex_2 = List.GetItemAtIndex(list=list, index=index_old)
watch_2 = Watch(getItemAtIndex_2)
code_block_2 = CodeBlock(oldIFC=watch_2) { oldIFC; }

# group: find IFCCURTAINWALL
code_block_3 = CodeBlock { {"IfcCurtainWall"}; }
watch_3 = Watch(code_block_3)
toUpper = String.ToUpper(watch_3)
string = StringInput("\u0028.*?\n")
code_block_4 = CodeBlock(a=toUpper, b=string) { a+b; }
fromPath = FileObject(code_block)  # "File.FromPath"
readText = File.ReadText(fromPath)
findRegularExpression = Custom[String.FindRegularExpression](RegEx=code_block_4, str=readText)  # Returns all occurences of a regular expression within a string (or list of strings). The syntax for regular expressions is explained at http://ironpython-test.readthedocs.org/en/latest/howto/regex.html
watch_4 = Watch(findRegularExpression)
python_script = Python(IN[0]=watch_4)
# ---------- python_script.python (11 lines) ----------
import clr
clr.AddReference('ProtoGeometry')
from Autodesk.DesignScript.Geometry import *
#The inputs to this node will be stored as a list in the IN variables.
dataEnteringNode = IN
OUT=[]
#Assign your output to the OUT variable.
for i in IN[0]:
	for j in i:
		OUT.append(j)
#OUT=IN[0][0]
# ----------------------------------------
watch_5 = Watch(python_script)
string_2 = StringInput("('")
string_3 = StringInput(",'")
string_4 = StringInput("');")
split = String.Split(watch_5, string_2, string_3, string_4)
watch_6 = Watch(split)
python_script_2 = Python(IN[0]=watch_6)
# ---------- python_script_2.python (10 lines) ----------
import clr
clr.AddReference('ProtoGeometry')
from Autodesk.DesignScript.Geometry import *
#The inputs to this node will be stored as a list in the IN variables.
dataEnteringNode = IN

#Assign your output to the OUT variable.
OUT=[]
for i in IN[0]:
	OUT.append(i[0] + "('" + i[len(i)-2])
# ----------------------------------------
watch_7 = Watch(python_script_2)
toUpper_2 = String.ToUpper(watch_3)
string_5 = StringInput("\u0028.*?\n")
code_block_5 = CodeBlock(a=toUpper_2, b=string_5) { a+b; }
fromPath_2 = FileObject(code_block_2)  # "File.FromPath"
readText_2 = File.ReadText(fromPath_2)
findRegularExpression_2 = Custom[String.FindRegularExpression](RegEx=code_block_5, str=readText_2)
watch_8 = Watch(findRegularExpression_2)
python_script_3 = Python(IN[0]=watch_8)  # same code as python_script
watch_9 = Watch(python_script_3)
string_6 = StringInput("('")
string_7 = StringInput(",'")
string_8 = StringInput("');")
split_2 = String.Split(watch_9, string_6, string_7, string_8)
watch_10 = Watch(split_2)
python_script_4 = Python(IN[0]=watch_10)  # same code as python_script_2
watch_11 = Watch(python_script_4)
watch_12 = Watch(code_block_5)
watch_13 = Watch(readText_2)
watch_14 = Watch(code_block_4)
watch_15 = Watch(readText)

code_block_6 = CodeBlock()
# ---------- code_block_6.designscript (40 lines) ----------
{"IFCWALLSTANDARDCASE",
"IfcBeam",
"IfcDoor",
"IfcColumn",
"IfcWindow",
"IfcMember",
"IfcCurtainWall",
"IfcRoof",
"IfcSlab",
"IfcRamp",
"IfcPlate",
"IfcPile",
"IfcRailing",
"IfcRampFlight",
"IfcStair",
"IfcStairFlight",
"IfcFooting",
"IfcCovering",
"IfcBuildingElementProxy",
"IfcFurnishingElement",
"IfcTransportElement",
"IfcDistributionChamberElement",
"IfcFlowSegment",
"IfcFlowFitting",
"IfcFlowController",
"IfcFlowMovingDevice",
"IfcFlowStorageDevice",
"IfcFlowTerminal",
"IfcFlowTreatmentDevice",
"IfcEnergyConversionDevice",
"IfcOpeningElement",
"IfcMechanicalFastener",
"IfcDiscreteAccessory",
"IfcSpace",
"IfcBuildingStorey",
"IfcSite",
"IfcGridAxis",
"IfcGrid",
"IfcZone",
"IfcElectricalCircuit"};
# ----------------------------------------
watch_16 = Watch(code_block_6)
string_9 = StringInput("\u0028\S{23}")

# group: Find the elements in STEP fle
toUpper_3 = String.ToUpper(watch_16)
string_10 = StringInput("\u0028\S{23}")
code_block_7 = CodeBlock(a=toUpper_3, b=string_10) { a+b; }
fromPath_3 = FileObject(code_block)  # "File.FromPath"
readText_3 = File.ReadText(fromPath_3)
findRegularExpression_3 = Custom[String.FindRegularExpression](RegEx=code_block_7, str=readText_3)
watch_17 = Watch(findRegularExpression_3)
python_script_5 = Python(IN[0]=watch_17)  # same code as python_script
watch_18 = Watch(python_script_5)
toUpper_4 = String.ToUpper(watch_16)
code_block_8 = CodeBlock(a=toUpper_4, b=string_9) { a+b; }
fromPath_4 = FileObject(code_block_2)  # "File.FromPath"
readText_4 = File.ReadText(fromPath_4)
findRegularExpression_4 = Custom[String.FindRegularExpression](RegEx=code_block_8, str=readText_4)
watch_19 = Watch(findRegularExpression_4)
python_script_6 = Python(IN[0]=watch_19)  # same code as python_script
watch_20 = Watch(python_script_6)
watch_21 = Watch(code_block_8)
watch_22 = Watch(code_block_7)
watch_23 = Watch(readText_3)
watch_24 = Watch(readText_4)

code_block_9 = CodeBlock(newerfile=watch_18) { newerfile; }
join = List.Join(watch_7, code_block_9)
code_block_10 = CodeBlock(olderfile=watch_20) { olderfile; }
join_2 = List.Join(watch_11, code_block_10)

# group: Add and Remove Detection
code_block_11 = CodeBlock(listTWO=join) { listTWO; }
code_block_12 = CodeBlock(listONE=join_2) { listONE; }

# group: ListTwo
watch_25 = Watch(code_block_11)

# group: ListOne
watch_26 = Watch(code_block_12)

# group: Remove List from List by Item not Value
python_script_7 = Python(IN[0]=watch_25, IN[1]=watch_26)
# ---------- python_script_7.python (13 lines) ----------
listA = IN[0]
listB = IN[1]
unmatched = []

#listC = [x for x in listA if x not in listB]
for x in range(len(listA)):
#	s = set(listA)
	if listA[x] in listB:
		listB.remove(listA[x])
	else:
		unmatched.append(listA[x])

OUT = [listB, unmatched]
# ----------------------------------------
code_block_13 = CodeBlock { 1; }
getItemAtIndex_3 = List.GetItemAtIndex(list=python_script_7, index=code_block_13)
code_block_14 = CodeBlock { ListOfItemsToRemove; }  # unwired: ListOfItemsToRemove
code_block_15 = CodeBlock { ListToRemoveFrom; }  # unwired: ListToRemoveFrom
code_block_16 = CodeBlock { 0; }
getItemAtIndex_4 = List.GetItemAtIndex(list=python_script_7, index=code_block_16)

# group: Remove List from List by Item not Value
code_block_17 = CodeBlock { ListOfItemsToRemove; }  # unwired: ListOfItemsToRemove
python_script_8 = Python(IN[0]=watch_26, IN[1]=watch_25)  # same code as python_script_7
code_block_18 = CodeBlock { 1; }
getItemAtIndex_5 = List.GetItemAtIndex(list=python_script_8, index=code_block_18)
code_block_19 = CodeBlock { ListToRemoveFrom; }  # unwired: ListToRemoveFrom
code_block_20 = CodeBlock { 0; }
getItemAtIndex_6 = List.GetItemAtIndex(list=python_script_8, index=code_block_20)

watch_27 = Watch(toUpper_3)
code_block_21 = CodeBlock { 0; }
getItemAtIndex_7 = List.GetItemAtIndex(list=watch_25, index=code_block_21)

# group: text mining pre-work for relocation and rotation detection
code_block_22 = CodeBlock()
# ---------- code_block_22.designscript (34 lines) ----------
{"IFCWALLSTANDARDCASE",
"IfcBeam",
"IfcDoor",
"IfcColumn",
"IfcWindow",
"IfcMember",
"IfcRoof",
"IfcSlab",
"IfcRamp",
"IfcPlate",
"IfcPile",
"IfcRailing",
"IfcRampFlight",
"IfcStairFlight",
"IfcFooting",
"IfcCovering",
"IfcBuildingElementProxy",
"IfcFurnishingElement",
"IfcTransportElement",
"IfcDistributionChamberElement",
"IfcFlowSegment",
"IfcFlowFitting",
"IfcFlowController",
"IfcFlowMovingDevice",
"IfcFlowStorageDevice",
"IfcFlowTerminal",
"IfcFlowTreatmentDevice",
"IfcEnergyConversionDevice",
"IfcOpeningElement",
"IfcMechanicalFastener",
"IfcDiscreteAccessory",
"IfcGridAxis",
"IfcGrid",
"IfcElectricalCircuit"};
# ----------------------------------------
toUpper_5 = String.ToUpper(code_block_22)
string_11 = StringInput("\u0028.*?\n")
code_block_23 = CodeBlock(a=toUpper_5, b=string_11) { a+b; }
watch_28 = Watch(code_block_23)
string_12 = StringInput("\n")
findRegularExpression_5 = Custom[String.FindRegularExpression](RegEx=code_block_23, str=watch_23)
watch_29 = Watch(findRegularExpression_5)
python_script_9 = Python(IN[0]=watch_29)  # same code as python_script
watch_30 = Watch(python_script_9)
string_13 = StringInput("#")
string_14 = StringInput("=.*?\n")
string_15 = StringInput("('")
string_16 = StringInput("',")
string_17 = StringInput("\n")
string_18 = StringInput("\n")
string_19 = StringInput("=.*?\n")
string_20 = StringInput(",")
string_21 = StringInput("=.*?\n")
string_22 = StringInput("((")
string_23 = StringInput("\n")
string_24 = StringInput("=.*?\n")
string_25 = StringInput("((")
string_26 = StringInput("((")

# group: importing the selected elements
selected_elements_csv = Input()  # "selected elements.csv"
watch_31 = Watch(selected_elements_csv)
python_script_10 = Python(IN[0]=watch_31)
# ---------- python_script_10.python (10 lines) ----------
import clr
clr.AddReference('ProtoGeometry')
from Autodesk.DesignScript.Geometry import *
#The inputs to this node will be stored as a list in the IN variables.
dataEnteringNode = IN
OUT =[]
#Assign your output to the OUT variable.
for i in IN[0]:
	if i[0] != None:
		OUT.append(i)
# ----------------------------------------
python_script_11 = Python(IN[0]=python_script_10)
# ---------- python_script_11.python (9 lines) ----------
import clr
clr.AddReference('ProtoGeometry')
from Autodesk.DesignScript.Geometry import *
#The inputs to this node will be stored as a list in the IN variables.
dataEnteringNode = IN
OUT =[]
#Assign your output to the OUT variable.
for i in IN[0]:
	OUT.append(i[1])
# ----------------------------------------
watch_32 = Watch(python_script_11)
string_27 = StringInput("-")
string_28 = StringInput(" ")
split_3 = String.Split(watch_32, string_27, string_28)
watch_33 = Watch(split_3)
string_29 = StringInput("\")
split_4 = String.Split(code_block_2, string_29)
lastItem = List.LastItem(split_4)
python_script_12 = Python(IN[0]=lastItem)
# ---------- python_script_12.python (8 lines) ----------
import clr
clr.AddReference('ProtoGeometry')
from Autodesk.DesignScript.Geometry import *
#The inputs to this node will be stored as a list in the IN variables.
dataEnteringNode = IN

#Assign your output to the OUT variable.
OUT = IN[0][:-4]
# ----------------------------------------
watch_34 = Watch(python_script_12)
string_30 = StringInput("-")
string_31 = StringInput(" ")
split_5 = String.Split(watch_34, string_30, string_31)
watch_35 = Watch(split_5)
date_comparison = Python(IN[0]=watch_33, IN[1]=watch_35)
# ---------- date_comparison.python (36 lines) ----------
import clr
clr.AddReference('ProtoGeometry')
from Autodesk.DesignScript.Geometry import *
#The inputs to this node will be stored as a list in the IN variables.
dataEnteringNode = IN
OUT = []
#Assign your output to the OUT variable.
for i in IN[0]:
	#check kardane sal
	if int(i[2]) > int(IN[1][2]):
		
		OUT.append(1)
	#check kardane mah
	if int(i[2]) == int(IN[1][2]) and int(i[0]) > int(IN[1][0]):
		
		OUT.append(1)
	#moqayese ruz	
	elif int(i[2]) == int(IN[1][2]) and int(i[0]) == int(IN[1][0]) and int(i[1]) > int(IN[1][1]):
		
		OUT.append(1)
	#moqayese saat
	elif int(i[2]) == int(IN[1][2]) and int(i[0]) == int(IN[1][0]) and int(i[1]) == int(IN[1][1]) and int(i[3]) > int(IN[1][3]):
		
		OUT.append(1)
	#Moqayese daqiqe
	elif int(i[2]) == int(IN[1][2]) and int(i[0]) == int(IN[1][0]) and int(i[1]) == int(IN[1][1]) and int(i[3]) == int(IN[1][3]) and int(i[4]) > int(IN[1][4]):
		
		OUT.append(1)
	#moqayese sanie
	elif int(i[2]) == int(IN[1][2]) and int(i[0]) == int(IN[1][0]) and int(i[1]) == int(IN[1][1]) and int(i[3]) == int(IN[1][3]) and int(i[4]) == int(IN[1][4]) and int(i[5]) > int(IN[1][5]):
		
		OUT.append(1)
	
	else: 
		
		OUT.append(0)
# ----------------------------------------
watch_36 = Watch(date_comparison)
string_32 = StringInput("\")
split_6 = String.Split(code_block, string_32)
lastItem_2 = List.LastItem(split_6)
python_script_13 = Python(IN[0]=lastItem_2)  # same code as python_script_12
watch_37 = Watch(python_script_13)
string_33 = StringInput("-")
split_7 = String.Split(watch_37, string_33, string_31)
watch_38 = Watch(split_7)
date_comparison_2 = Python(IN[0]=watch_33, IN[1]=watch_38)
# ---------- date_comparison_2.python (36 lines) ----------
import clr
clr.AddReference('ProtoGeometry')
from Autodesk.DesignScript.Geometry import *
#The inputs to this node will be stored as a list in the IN variables.
dataEnteringNode = IN
OUT = []
#Assign your output to the OUT variable.
for i in IN[0]:
	#check kardane sal
	if int(i[2]) < int(IN[1][2]):
		
		OUT.append(1)
	#check kardane mah
	if int(i[2]) == int(IN[1][2]) and int(i[0]) < int(IN[1][0]):
		
		OUT.append(1)
	#moqayese ruz	
	elif int(i[2]) == int(IN[1][2]) and int(i[0]) == int(IN[1][0]) and int(i[1]) < int(IN[1][1]):
		
		OUT.append(1)
	#moqayese saat
	elif int(i[2]) == int(IN[1][2]) and int(i[0]) == int(IN[1][0]) and int(i[1]) == int(IN[1][1]) and int(i[3]) < int(IN[1][3]):
		
		OUT.append(1)
	#Moqayese daqiqe
	elif int(i[2]) == int(IN[1][2]) and int(i[0]) == int(IN[1][0]) and int(i[1]) == int(IN[1][1]) and int(i[3]) == int(IN[1][3]) and int(i[4]) < int(IN[1][4]):
		
		OUT.append(1)
	#moqayese sanie
	elif int(i[2]) == int(IN[1][2]) and int(i[0]) == int(IN[1][0]) and int(i[1]) == int(IN[1][1]) and int(i[3]) == int(IN[1][3]) and int(i[4]) == int(IN[1][4]) and int(i[5]) < int(IN[1][5]):
		
		OUT.append(1)
	
	else: 
		
		OUT.append(0)
# ----------------------------------------
watch_39 = Watch(date_comparison_2)
mul = watch_36 * watch_39
watch_40 = Watch(mul)
only_keep_the_selected_elemnts = Python(IN[0]=python_script_10, IN[1]=watch_40)  # "Only keep the selected elemnts' ID"
# ---------- only_keep_the_selected_elemnts.python (12 lines) ----------
import clr
clr.AddReference('ProtoGeometry')
from Autodesk.DesignScript.Geometry import *
#The inputs to this node will be stored as a list in the IN variables.
dataEnteringNode = IN
a =[]
#Assign your output to the OUT variable.
for i in IN[0]:
	if IN[1][IN[0].index(i)] == 1:
		a.append(i[0])
		
OUT = list(set(a))
# ----------------------------------------
watch_41 = Watch(python_script_10)

watch_42 = Watch(only_keep_the_selected_elemnts)
python_script_14 = Python(IN[0]=watch_42, IN[1]=watch_30)
# ---------- python_script_14.python (15 lines) ----------
import clr
clr.AddReference('ProtoGeometry')
from Autodesk.DesignScript.Geometry import *
#The inputs to this node will be stored as a list in the IN variables.
dataEnteringNode = IN
OUT=[]
#Assign your output to the OUT variable.
for i in IN[1]:
	for j in IN[0]:
		if str(j) in i:
			OUT.append(i)
			break
	
		
	
# ----------------------------------------
watch_43 = Watch(python_script_14)

# group (continued): text mining pre-work for relocation and rotation detection
split_8 = String.Split(watch_43, string_13)
watch_44 = Watch(split_8)
python_script_15 = Python(IN[0]=watch_44)
# ---------- python_script_15.python (11 lines) ----------
import clr
clr.AddReference('ProtoGeometry')
from Autodesk.DesignScript.Geometry import *
#The inputs to this node will be stored as a list in the IN variables.
dataEnteringNode = IN
OUT=[]
#Assign your output to the OUT variable.
for i in IN[0]:
	#for j in i:
		OUT.append('#' + i[2][:-1])
#OUT=IN[0][0]
# ----------------------------------------
watch_45 = Watch(python_script_15)
code_block_24 = CodeBlock(a=string_12, b=watch_45, c=string_14) { a+b+c; }
watch_46 = Watch(code_block_24)
split_9 = String.Split(watch_43, string_15, string_16)
watch_47 = Watch(split_9)
findRegularExpression_6 = Custom[String.FindRegularExpression](RegEx=code_block_24, str=watch_23)
watch_48 = Watch(findRegularExpression_6)
python_script_16 = Python(IN[0]=watch_48)
# ---------- python_script_16.python (26 lines) ----------
import clr
clr.AddReference('ProtoGeometry')
from Autodesk.DesignScript.Geometry import *
#The inputs to this node will be stored as a list in the IN variables.
dataEnteringNode = IN
OUT=[]
#Assign your output to the OUT variable.
for i in IN[0]:
	#for j in i:
	if i[0][-9] == '#':
		OUT.append(i[0][-9:-4])
	elif i[0][-10] == '#':
		OUT.append(i[0][-10:-4])
	elif i[0][-11] == '#':
		OUT.append(i[0][-11:-4])
	elif i[0][-12] == '#':
		OUT.append(i[0][-12:-4])
	elif i[0][-8] == '#':
		OUT.append(i[0][-8:-4])
	elif i[0][-7] == '#':
		OUT.append(i[0][-7:-4])
	elif i[0][-6] == '#':
		OUT.append(i[0][-6:-4])
	elif i[0][-5] == '#':
		OUT.append(i[0][-5:-4])
#OUT=IN[0][0]
# ----------------------------------------
watch_49 = Watch(python_script_16)
code_block_25 = CodeBlock(a=string_18, b=watch_49, c=string_19) { a+b+c; }
findRegularExpression_7 = Custom[String.FindRegularExpression](RegEx=code_block_25, str=watch_23)
watch_50 = Watch(findRegularExpression_7)
split_10 = String.Split(watch_50, string_20)
watch_51 = Watch(split_10)
python_script_17 = Python(IN[0]=watch_51)
# ---------- python_script_17.python (25 lines) ----------
import clr
clr.AddReference('ProtoGeometry')
from Autodesk.DesignScript.Geometry import *
#The inputs to this node will be stored as a list in the IN variables.
dataEnteringNode = IN
OUT=[]
#Assign your output to the OUT variable.
for i in IN[0]:
	#for j in i:
	if i[0][0][-2] == '#':
		OUT.append(i[0][0][-2:])
	if i[0][0][-3] == '#':
		OUT.append(i[0][0][-3:])
	if i[0][0][-4] == '#':
		OUT.append(i[0][0][-4:])
	if i[0][0][-5] == '#':
		OUT.append(i[0][0][-5:])
	if i[0][0][-6] == '#':
		OUT.append(i[0][0][-6:])
	if i[0][0][-7] == '#':
		OUT.append(i[0][0][-7:])
	if i[0][0][-8] == '#':
		OUT.append(i[0][0][-8:])
	
#OUT=IN[0][0]
# ----------------------------------------
watch_52 = Watch(python_script_17)
code_block_26 = CodeBlock(a=string_17, b=watch_52, c=string_21) { a+b+c; }
findRegularExpression_8 = Custom[String.FindRegularExpression](RegEx=code_block_26, str=watch_23)
watch_53 = Watch(findRegularExpression_8)
split_11 = String.Split(watch_53, string_22)
watch_54 = Watch(split_11)
python_script_18 = Python(IN[0]=watch_51)
# ---------- python_script_18.python (12 lines) ----------
import clr
clr.AddReference('ProtoGeometry')
from Autodesk.DesignScript.Geometry import *
#The inputs to this node will be stored as a list in the IN variables.
dataEnteringNode = IN
OUT=[]
#Assign your output to the OUT variable.
for i in IN[0]:
	#for j in i:
		OUT.append(i[0][2][:-4])
		
#OUT=IN[0][0]
# ----------------------------------------
watch_55 = Watch(python_script_18)
python_script_19 = Python(IN[0]=watch_55)
# ---------- python_script_19.python (13 lines) ----------
import clr
clr.AddReference('ProtoGeometry')
from Autodesk.DesignScript.Geometry import *
#The inputs to this node will be stored as a list in the IN variables.
dataEnteringNode = IN
OUT=[]
#Assign your output to the OUT variable.
for i in IN[0]:
	if i == '$':
		OUT.append('#11')
	else:
		OUT.append(i)
#OUT=IN[0][0]
# ----------------------------------------
watch_56 = Watch(python_script_19)
code_block_27 = CodeBlock(a=string_23, b=watch_56, c=string_24) { a+b+c; }
findRegularExpression_9 = Custom[String.FindRegularExpression](RegEx=code_block_27, str=watch_23)
watch_57 = Watch(findRegularExpression_9)
split_12 = String.Split(watch_57, string_25)
watch_58 = Watch(split_12)
python_script_20 = Python(IN[0]=watch_51)
# ---------- python_script_20.python (12 lines) ----------
import clr
clr.AddReference('ProtoGeometry')
from Autodesk.DesignScript.Geometry import *
#The inputs to this node will be stored as a list in the IN variables.
dataEnteringNode = IN
OUT=[]
#Assign your output to the OUT variable.
for i in IN[0]:
	#for j in i:
		OUT.append(i[0][1])
		
#OUT=IN[0][0]
# ----------------------------------------
watch_59 = Watch(python_script_20)
python_script_21 = Python(IN[0]=watch_59)
# ---------- python_script_21.python (13 lines) ----------
import clr
clr.AddReference('ProtoGeometry')
from Autodesk.DesignScript.Geometry import *
#The inputs to this node will be stored as a list in the IN variables.
dataEnteringNode = IN
OUT=[]
#Assign your output to the OUT variable.
for i in IN[0]:
	if i == '$':
		OUT.append('#19')
	else:
		OUT.append(i)
#OUT=IN[0][0]
# ----------------------------------------
watch_60 = Watch(python_script_21)
code_block_28 = CodeBlock(a=string_23, b=watch_60, c=string_24) { a+b+c; }
findRegularExpression_10 = Custom[String.FindRegularExpression](RegEx=code_block_28, str=watch_23)
watch_61 = Watch(findRegularExpression_10)
split_13 = String.Split(watch_61, string_26)
watch_62 = Watch(split_13)

# group: text mining pre-work for relocation and rotation detection
string_34 = StringInput("\n")
code_block_29 = CodeBlock()  # same code as code_block_22
toUpper_6 = String.ToUpper(code_block_29)
string_35 = StringInput("\u0028.*?\n")
code_block_30 = CodeBlock(a=toUpper_6, b=string_35) { a+b; }
findRegularExpression_11 = Custom[String.FindRegularExpression](RegEx=code_block_30, str=watch_24)
watch_63 = Watch(findRegularExpression_11)
python_script_22 = Python(IN[0]=watch_63)  # same code as python_script
watch_64 = Watch(python_script_22)
string_36 = StringInput("#")
string_37 = StringInput("=.*?\n")
watch_65 = Watch(code_block_30)
string_38 = StringInput("('")
string_39 = StringInput("',")
string_40 = StringInput("\n")
string_41 = StringInput("\n")
string_42 = StringInput("=.*?\n")
string_43 = StringInput(",")
string_44 = StringInput("=.*?\n")
string_45 = StringInput("((")
string_46 = StringInput("\n")
string_47 = StringInput("=.*?\n")
string_48 = StringInput("((")
string_49 = StringInput("((")

# group: peroperty information of the element in the old IFC file
watch_66 = Watch(only_keep_the_selected_elemnts)
string_50 = StringInput("\u0027")
string_51 = StringInput("\n")
string_52 = StringInput("IFCRELDEFINESBYPROPERTIES")
string_53 = StringInput("\u0028.*?\n")
code_block_31 = CodeBlock(a=string_52, d=string_53) { a+d; }
watch_67 = Watch(code_block_31)
findRegularExpression_12 = Custom[String.FindRegularExpression](RegEx=watch_67, str=watch_24)
watch_68 = Watch(findRegularExpression_12)
string_54 = StringInput(",(")
string_55 = StringInput("),")
split_14 = String.Split(watch_68, string_54, string_55)
watch_69 = Watch(split_14)
get_the_element_number = Python(IN[0]=watch_69)
# ---------- get_the_element_number.python (11 lines) ----------
import clr
clr.AddReference('ProtoGeometry')
from Autodesk.DesignScript.Geometry import *
#The inputs to this node will be stored as a list in the IN variables.
dataEnteringNode = IN
OUT=[]
#Assign your output to the OUT variable.
for i in IN[0]:
	#for j in i:
		OUT.append(i[1])
#OUT=IN[0][0]
# ----------------------------------------
watch_70 = Watch(get_the_element_number)
string_56 = StringInput("=.*?\n")
code_block_32 = CodeBlock(a=string_51, b=watch_70, c=string_56) { a+b+c; }
watch_71 = Watch(code_block_32)
watch_72 = Watch(only_keep_the_selected_elemnts)
findRegularExpression_13 = Custom[String.FindRegularExpression](RegEx=code_block_32, str=watch_24)
watch_73 = Watch(findRegularExpression_13)
python_script_23 = Python(IN[0]=watch_73)  # same code as python_script
watch_74 = Watch(python_script_23)
python_script_24 = Python(IN[0]=watch_72, IN[1]=watch_74)  # same code as python_script_14
watch_75 = Watch(python_script_24)
string_57 = StringInput("= ")
string_58 = StringInput("('")
string_59 = StringInput("',")
split_15 = String.Split(watch_75, string_57, string_58, string_59)
watch_76 = Watch(split_15)
string_60 = StringInput("\n#")
string_61 = StringInput("\n")
code_block_33 = CodeBlock()  # same code as code_block_6
toUpper_7 = String.ToUpper(code_block_33)
watch_77 = Watch(toUpper_7)
python_script_25 = Python(IN[0]=watch_76, IN[1]=watch_77, IN[2]=watch_69)
# ---------- python_script_25.python (18 lines) ----------
import clr
clr.AddReference('ProtoGeometry')
from Autodesk.DesignScript.Geometry import *
#The inputs to this node will be stored as a list in the IN variables.
dataEnteringNode = IN
OUT=[]
a=0
#Assign your output to the OUT variable.
for i in IN[0]:

	
	if i[1] in IN[1]:
		OUT.append(IN[2][a][2][:-4])
		#OUT.append(IN[0].index(i))
	else:
		OUT.append('place holder')
	a = a + 1
#OUT=IN[0][0]
# ----------------------------------------
watch_78 = Watch(python_script_25)
string_62 = StringInput("=.*?\n")
code_block_34 = CodeBlock(a=string_61, b=watch_78, c=string_62) { a+b+c; }
watch_79 = Watch(code_block_34)
findRegularExpression_14 = Custom[String.FindRegularExpression](RegEx=watch_79, str=watch_24)
watch_80 = Watch(findRegularExpression_14)
python_script_26 = Python(IN[0]=watch_80)
# ---------- python_script_26.python (14 lines) ----------
import clr
clr.AddReference('ProtoGeometry')
from Autodesk.DesignScript.Geometry import *
#The inputs to this node will be stored as a list in the IN variables.
dataEnteringNode = IN
OUT=[]
#Assign your output to the OUT variable.
for i in IN[0]:	

	for j in i:
			OUT.append(j)
	if i == []:
		OUT.append('place holder')
#OUT=IN[0][0]
# ----------------------------------------
watch_81 = Watch(python_script_26)
string_63 = StringInput(",(#")
string_64 = StringInput("));")
string_65 = StringInput(",#")
split_16 = String.Split(watch_81, string_63, string_64, string_65)
watch_82 = Watch(split_16)
string_66 = StringInput("=.*?\n")
code_block_35 = CodeBlock(a=string_60, b=watch_82, c=string_66) { a+b+c; }
watch_83 = Watch(code_block_35)
findRegularExpression_15 = Custom[String.FindRegularExpression](RegEx=watch_83, str=watch_24)
watch_84 = Watch(findRegularExpression_15)
python_script_27 = Python(IN[0]=watch_84)
# ---------- python_script_27.python (14 lines) ----------
import clr
clr.AddReference('ProtoGeometry')
from Autodesk.DesignScript.Geometry import *
#The inputs to this node will be stored as a list in the IN variables.
dataEnteringNode = IN
OUT= []
a=[]
#Assign your output to the OUT variable.
for i in IN[0]:
	for j in i:
		if not (j is None) and not (j == []):
			a.append(j[0])
	OUT.append(a)
	a=[]
# ----------------------------------------
watch_85 = Watch(python_script_27)
extra_information_titles_to_be = CodeBlock()  # "Extra information titles to be added to the data base"
# ---------- extra_information_titles_to_be.designscript (2 lines) ----------
{"Area", "Volume", "Family Name",
"Type Name", "Phase Created"};
# ----------------------------------------
watch_86 = Watch(extra_information_titles_to_be)
code_block_36 = CodeBlock()
# ---------- code_block_36.designscript (5 lines) ----------
{
"Structural Usage", "IsExternal",
"Base is Attached", "Top is Attached",
"LoadBearing", "ExtendToStructure"
};
# ----------------------------------------
watch_87 = Watch(code_block_36)
All_Activities = Input()  # "All Activities?"
python_script_28 = Python(IN[0]=watch_86, IN[1]=watch_87, IN[2]=All_Activities)
# ---------- python_script_28.python (16 lines) ----------
import clr
clr.AddReference('ProtoGeometry')
from Autodesk.DesignScript.Geometry import *
#The inputs to this node will be stored as a list in the IN variables.
dataEnteringNode = IN
OUT=0
#Assign your output to the OUT variable.
if IN[2]:
	a= list(IN[0])
	b= list(IN[1])
	OUT = a + b
	#OUT=0	
	
	#OUT = a | b
else: 
	OUT = list(IN[0])
# ----------------------------------------
watch_88 = Watch(python_script_28)
python_script_29 = Python(IN[0]=watch_85, IN[1]=watch_88)
# ---------- python_script_29.python (18 lines) ----------
import clr
clr.AddReference('ProtoGeometry')
from Autodesk.DesignScript.Geometry import *
#The inputs to this node will be stored as a list in the IN variables.
dataEnteringNode = IN
c=[]
d=[]
#Assign your output to the OUT variable.
for i in IN[0]:
	for j in i:
		for k in IN[1]:
			if (k in j):
				if not (j in c):
					c.append(j)
	d.append(c)
	c=[]

OUT=d
# ----------------------------------------
watch_89 = Watch(python_script_29)
python_script_30 = Python(IN[0]=watch_76, IN[1]=watch_89)
# ---------- python_script_30.python (33 lines) ----------
import clr
clr.AddReference('ProtoGeometry')
from Autodesk.DesignScript.Geometry import *
#The inputs to this node will be stored as a list in the IN variables.
dataEnteringNode = IN
a= IN[0]
b= list(IN[1])
OUT = []
f=[]
g=[]
x=0
#Assign your output to the OUT variable.
for i in b:
	i.append(x)
	x=x+1
#OUT=b
#for i in b:
	#i.append(x)
	#x=x+1
for i in b:
	#for j in b:
	#for j in i:
		#if len(j) > 6:
		k=0
		while k < len(i)-1:
		
			c = a[b.index(i)][1] + "'," + a[b.index(i)][2] + i[k] #+ j 
			OUT.append(c)
			k=k+1
	#for j in i:
		#d = j
	#if (i != []):
		#i.append(a[b.index(i)][2])
# ----------------------------------------
watch_90 = Watch(python_script_30)
string_67 = StringInput("#")
string_68 = StringInput("IFCPROPERTYSINGLEVALUE('")
string_69 = StringInput("',")
string_70 = StringInput(",")
split_17 = String.Split(watch_90, string_67, string_68, string_69, string_70)
watch_91 = Watch(split_17)

python_script_31 = Python(IN[0]=watch_66, IN[1]=watch_64)  # same code as python_script_14
watch_92 = Watch(python_script_31)

# group (continued): text mining pre-work for relocation and rotation detection
split_18 = String.Split(watch_92, string_36)
watch_93 = Watch(split_18)
python_script_32 = Python(IN[0]=watch_93)  # same code as python_script_15
watch_94 = Watch(python_script_32)
code_block_37 = CodeBlock(a=string_34, b=watch_94, c=string_37) { a+b+c; }
watch_95 = Watch(code_block_37)
split_19 = String.Split(watch_92, string_38, string_39)
watch_96 = Watch(split_19)
findRegularExpression_16 = Custom[String.FindRegularExpression](RegEx=code_block_37, str=watch_24)
watch_97 = Watch(findRegularExpression_16)
python_script_33 = Python(IN[0]=watch_97)  # same code as python_script_16
watch_98 = Watch(python_script_33)
code_block_38 = CodeBlock(a=string_41, b=watch_98, c=string_42) { a+b+c; }
findRegularExpression_17 = Custom[String.FindRegularExpression](RegEx=code_block_38, str=watch_24)
watch_99 = Watch(findRegularExpression_17)
split_20 = String.Split(watch_99, string_43)
watch_100 = Watch(split_20)
python_script_34 = Python(IN[0]=watch_100)  # same code as python_script_17
watch_101 = Watch(python_script_34)
code_block_39 = CodeBlock(a=string_40, b=watch_101, c=string_44) { a+b+c; }
findRegularExpression_18 = Custom[String.FindRegularExpression](RegEx=code_block_39, str=watch_24)
watch_102 = Watch(findRegularExpression_18)
split_21 = String.Split(watch_102, string_45)
watch_103 = Watch(split_21)
python_script_35 = Python(IN[0]=watch_100)  # same code as python_script_18
watch_104 = Watch(python_script_35)
python_script_36 = Python(IN[0]=watch_104)  # same code as python_script_19
watch_105 = Watch(python_script_36)
code_block_40 = CodeBlock(a=string_46, b=watch_105, c=string_47) { a+b+c; }
findRegularExpression_19 = Custom[String.FindRegularExpression](RegEx=code_block_40, str=watch_24)
watch_106 = Watch(findRegularExpression_19)
split_22 = String.Split(watch_106, string_48)
watch_107 = Watch(split_22)
python_script_37 = Python(IN[0]=watch_100)  # same code as python_script_20
watch_108 = Watch(python_script_37)
python_script_38 = Python(IN[0]=watch_108)  # same code as python_script_21
watch_109 = Watch(python_script_38)
code_block_41 = CodeBlock(a=string_46, b=watch_109, c=string_47) { a+b+c; }
findRegularExpression_20 = Custom[String.FindRegularExpression](RegEx=code_block_41, str=watch_24)
watch_110 = Watch(findRegularExpression_20)
split_23 = String.Split(watch_110, string_49)
watch_111 = Watch(split_23)

string_71 = StringInput("\u0027")
string_72 = StringInput("\n")
string_73 = StringInput("IFCRELDEFINESBYPROPERTIES")
string_74 = StringInput("\u0028.*?\n")
code_block_42 = CodeBlock(a=string_73, d=string_74) { a+d; }
watch_112 = Watch(code_block_42)
findRegularExpression_21 = Custom[String.FindRegularExpression](RegEx=watch_112, str=readText_3)
watch_113 = Watch(findRegularExpression_21)
string_75 = StringInput(",(")
string_76 = StringInput("),")
split_24 = String.Split(watch_113, string_75, string_76)
watch_114 = Watch(split_24)
get_the_element_number_2 = Python(IN[0]=watch_114)  # same code as get_the_element_number
watch_115 = Watch(get_the_element_number_2)
string_77 = StringInput("=.*?\n")
code_block_43 = CodeBlock(a=string_72, b=watch_115, c=string_77) { a+b+c; }
watch_116 = Watch(code_block_43)
extra_information_titles_to_be_2 = CodeBlock()  # "Extra information titles to be added to the data base"
# ---------- extra_information_titles_to_be_2.designscript (2 lines) ----------
{"Area", "Volume", "Family Name",
"Type Name", "Phase Created", "ThermalTransmittance"};
# ----------------------------------------
code_block_44 = CodeBlock()  # same code as code_block_36
watch_117 = Watch(split_17)
string_78 = StringInput("\")
split_25 = String.Split(code_block_2, string_78)
watch_118 = Watch(split_25)
python_script_39 = Python(IN[0]=watch_118)
# ---------- python_script_39.python (8 lines) ----------
import clr
clr.AddReference('ProtoGeometry')
from Autodesk.DesignScript.Geometry import *
#The inputs to this node will be stored as a list in the IN variables.
dataEnteringNode = IN

#Assign your output to the OUT variable.
OUT = IN[0][-1][:-4]
# ----------------------------------------
watch_119 = Watch(python_script_39)
watch_120 = Watch(only_keep_the_selected_elemnts)
findRegularExpression_22 = Custom[String.FindRegularExpression](RegEx=code_block_43, str=watch_23)
watch_121 = Watch(findRegularExpression_22)
python_script_40 = Python(IN[0]=watch_121)  # same code as python_script
watch_122 = Watch(python_script_40)
python_script_41 = Python(IN[0]=watch_120, IN[1]=watch_122)  # same code as python_script_14
watch_123 = Watch(python_script_41)
string_79 = StringInput("= ")
string_80 = StringInput("('")
string_81 = StringInput("',")
split_26 = String.Split(watch_123, string_79, string_80, string_81)
watch_124 = Watch(split_26)
string_82 = StringInput("\n#")
string_83 = StringInput("\n")
code_block_45 = CodeBlock()  # same code as code_block_6
toUpper_8 = String.ToUpper(code_block_45)
watch_125 = Watch(toUpper_8)
python_script_42 = Python(IN[0]=watch_124, IN[1]=watch_125, IN[2]=watch_114)  # same code as python_script_25
watch_126 = Watch(python_script_42)
string_84 = StringInput("=.*?\n")
code_block_46 = CodeBlock(a=string_83, b=watch_126, c=string_84) { a+b+c; }
watch_127 = Watch(code_block_46)
findRegularExpression_23 = Custom[String.FindRegularExpression](RegEx=watch_127, str=watch_23)
watch_128 = Watch(findRegularExpression_23)
python_script_43 = Python(IN[0]=watch_128)  # same code as python_script_26
watch_129 = Watch(python_script_43)
string_85 = StringInput(",(#")
string_86 = StringInput("));")
string_87 = StringInput(",#")
split_27 = String.Split(watch_129, string_85, string_86, string_87)
watch_130 = Watch(split_27)
string_88 = StringInput("=.*?\n")
code_block_47 = CodeBlock(a=string_82, b=watch_130, c=string_88) { a+b+c; }
watch_131 = Watch(code_block_47)
findRegularExpression_24 = Custom[String.FindRegularExpression](RegEx=watch_131, str=watch_23)
watch_132 = Watch(findRegularExpression_24)
python_script_44 = Python(IN[0]=watch_132)  # same code as python_script_27
watch_133 = Watch(python_script_44)
extra_information_titles_to_be_3 = CodeBlock()  # "Extra information titles to be added to the data base"; same code as extra_information_titles_to_be
watch_134 = Watch(extra_information_titles_to_be_3)
code_block_48 = CodeBlock()
# ---------- code_block_48.designscript (4 lines) ----------
{
"Structural Usage", "IsExternal",
"Base is Attached", "Top is Attached"
};
# ----------------------------------------
watch_135 = Watch(code_block_48)
All_Activities_2 = Input(All Activities?)
python_script_45 = Python(IN[0]=watch_134, IN[1]=watch_135, IN[2]=All_Activities_2)  # same code as python_script_28
watch_136 = Watch(python_script_45)
python_script_46 = Python(IN[0]=watch_133, IN[1]=watch_136)  # same code as python_script_29
watch_137 = Watch(python_script_46)
python_script_47 = Python(IN[0]=watch_124, IN[1]=watch_137)  # same code as python_script_30
watch_138 = Watch(python_script_47)
string_89 = StringInput("#")
string_90 = StringInput("IFCPROPERTYSINGLEVALUE('")
string_91 = StringInput("',")
string_92 = StringInput(",")
split_28 = String.Split(watch_138, string_89, string_90, string_91, string_92)
watch_139 = Watch(split_28)
string_93 = StringInput("\")
split_29 = String.Split(code_block, string_93)
watch_140 = Watch(split_29)
python_script_48 = Python(IN[0]=watch_140, IN[1]=python_script_39)
# ---------- python_script_48.python (9 lines) ----------
import clr
clr.AddReference('ProtoGeometry')
from Autodesk.DesignScript.Geometry import *
#The inputs to this node will be stored as a list in the IN variables.
dataEnteringNode = IN

#Assign your output to the OUT variable.
a = IN[0][-1][:-4]
OUT = [IN[1], a]
# ----------------------------------------
watch_141 = Watch(python_script_48)

# group: finding the design "author"
string_94 = StringInput("'\S+")
string_95 = StringInput("',\$,\$,\$,\$,\$\);")
code_block_49 = CodeBlock(a=string_94, b=string_95) { a+b; }
watch_142 = Watch(code_block_49)
findRegularExpression_25 = Custom[String.FindRegularExpression](RegEx=watch_142, str=readText_3)
watch_143 = Watch(findRegularExpression_25)
code_block_50 = CodeBlock { 0; }
code_block_51 = CodeBlock { 4; }
remove = String.Remove(str=watch_143, startIndex=code_block_50, count=code_block_51)
watch_144 = Watch(remove)
string_96 = StringInput("',")
split_30 = String.Split(watch_144, string_96)
watch_145 = Watch(split_30)
python_script_49 = Python(IN[0]=watch_145)
# ---------- python_script_49.python (9 lines) ----------
import clr
clr.AddReference('ProtoGeometry')
from Autodesk.DesignScript.Geometry import *
#The inputs to this node will be stored as a list in the IN variables.
dataEnteringNode = IN

#Assign your output to the OUT variable.

OUT = IN[0][0][len(IN[0])-1]
# ----------------------------------------
watch_146 = Watch(python_script_49)

python_script_50 = Python(IN[0]=watch_91, IN[1]=watch_139, IN[2]=watch_141, IN[3]=watch_146)
# ---------- python_script_50.python (38 lines) ----------
import clr
clr.AddReference('ProtoGeometry')
from Autodesk.DesignScript.Geometry import *
#The inputs to this node will be stored as a list in the IN variables.
dataEnteringNode = IN

#Assign your output to the OUT variable.
OUT = []
a=[]
for i in IN [1]:
	for j in IN[0]:
		if (len(i) == 7) and (i[1] == j[1]) and (i[3] == j[3]) and (i[5] != j[5]):
			a.append(['"' + i[3] + '" of "' + i[0] + '" changed', i[1][:-2], IN[2][0], IN[2][1], IN[3]])
			
for i in a:
	if a.count(i) == 1:
		OUT.append(i)
#for i in IN[0]:
		#OUT.append(i)
#for i in IN[1]:
	#OUT.append(i)
#a=[]
#for i in IN[1]:
#	a.append([ i[0] , i[1] , i[3] ])
	
#b=[]
#for j in IN[0]:
#	b.append([ j[0] , j[1] , j[3] ])
	
#for i in a:
#	if not (i in b):
#		OUT.append('"' + i[2] + '" of "' + i[0] + '" added')

#for i in b:
#	if not (i in a):
#		OUT.append('"' + i[2] + '" of "' + i[0] + '" removed')
			
		
# ----------------------------------------
watch_147 = Watch(python_script_50)
csv_directory_path = Input()

# group: Rotation Detector
rotation_detector = Python(IN[0]=watch_96, IN[1]=watch_103, IN[2]=watch_47, IN[3]=watch_54, IN[4]=watch_141, IN[5]=watch_146)
# ---------- rotation_detector.python (16 lines) ----------
import clr
clr.AddReference('ProtoGeometry')
from Autodesk.DesignScript.Geometry import *
#The inputs to this node will be stored as a list in the IN variables.
dataEnteringNode = IN
OUT=[]
#Assign your output to the OUT variable.
for i in IN[0]:
	for j in IN[2]:
		if i[1] == j[1]:
			#OUT.append(IN[1][IN[0].index(i)][0][1])
			if IN[1][IN[0].index(i)][0][1] != IN[3][IN[2].index(j)][0][1]:
				OUT.append([i[0] + " relocated", i[1] + " relocated", IN[4][0], IN[4][1], IN[5]])
				

#OUT=IN[0][0]
# ----------------------------------------
watch_148 = Watch(rotation_detector)

# group: Horizontal Rotation
rotation_detector_2 = Python(IN[0]=watch_96, IN[1]=watch_107, IN[2]=watch_47, IN[3]=watch_58, IN[4]=watch_141, IN[5]=watch_146)
# ---------- rotation_detector_2.python (16 lines) ----------
import clr
clr.AddReference('ProtoGeometry')
from Autodesk.DesignScript.Geometry import *
#The inputs to this node will be stored as a list in the IN variables.
dataEnteringNode = IN
OUT=[]
#Assign your output to the OUT variable.
for i in IN[0]:
	for j in IN[2]:
		if i[1] == j[1]:
			#OUT.append(IN[1][IN[0].index(i)][0][1])
			if IN[1][IN[0].index(i)][0][1] != IN[3][IN[2].index(j)][0][1]:
				OUT.append([i[0] + " Rotated", i[1] + " Rotated", IN[4][0], IN[4][1], IN[5]])
				

#OUT=IN[0][0]
# ----------------------------------------
watch_149 = Watch(rotation_detector_2)

# group: Vertical Rotation
rotation_detector_3 = Python(IN[0]=watch_96, IN[1]=watch_111, IN[2]=watch_47, IN[3]=watch_62, IN[4]=watch_141, IN[5]=watch_146)  # same code as rotation_detector_2
watch_150 = Watch(rotation_detector_3)

# group (continued): Add and Remove Detection
watch_151 = Watch(getItemAtIndex_4)
code_block_52 = CodeBlock(inListONEbutNotInListTwo=watch_151) { inListONEbutNotInListTwo; }

code_block_53 = CodeBlock(removedFromNewFile=code_block_52) { removedFromNewFile; }
code_block_54 = CodeBlock { "('"; }
split_31 = String.Split(code_block_53, code_block_54)
watch_152 = Watch(split_31)
code_block_55 = CodeBlock(a=watch_152) { a+" Removed"; }
python_script_51 = Python(IN[0]=code_block_55, IN[1]=watch_141, IN[2]=watch_146)
# ---------- python_script_51.python (12 lines) ----------
import clr
clr.AddReference('ProtoGeometry')
from Autodesk.DesignScript.Geometry import *
#The inputs to this node will be stored as a list in the IN variables.
dataEnteringNode = IN
OUT=[]
#Assign your output to the OUT variable.
for i in IN[0]:
	i.append(IN[1][0])
	i.append(IN[1][1])
	i.append(IN[2])
OUT = IN[0]
# ----------------------------------------
watch_153 = Watch(python_script_51)

# group: Extras in List Two
watch_154 = Watch(getItemAtIndex_6)

# group (continued): Add and Remove Detection
code_block_56 = CodeBlock(inListTWObutNotInListOne=watch_154) { inListTWObutNotInListOne; }

code_block_57 = CodeBlock(addedToNewFile=code_block_56) { addedToNewFile; }
code_block_58 = CodeBlock { "('"; }
split_32 = String.Split(code_block_57, code_block_58)
watch_155 = Watch(split_32)
code_block_59 = CodeBlock(a=watch_155) { a +" Added"; }
python_script_52 = Python(IN[0]=code_block_59, IN[1]=watch_141, IN[2]=watch_146)  # same code as python_script_51
watch_156 = Watch(python_script_52)
element_selection_logger = Python(IN[0]=watch_156, IN[1]=csv_directory_path)
# ---------- element_selection_logger.python (39 lines) ----------
# Original Script by EwanO 2018 (Sastrugi Package) 
# Use as you like :-)
# This code creates and appends items to a CSV file on the Desktop that
# lists elements fed to the input.

import clr
import System
from System.IO import Directory

import sys
# load python
#pyt_path = r'C:\Program Files (x86)\IronPython.2.7.8\Lib'
#sys.path.append(pyt_path)

#import os

## set the output directory and gather log data
#main_dir = 'C:\\Users'
#user = os.environ.get('USERNAME')
#dir = main_dir + '\\' + user + '\\Desktop'
dir = IN[1]
# generate the file name for the log file

a = ''
for i in IN[0]:
	for j in i:
		if i.index(j) == len(i)-1:
			a= a + str(j) + '\n'
		else:
			a= a + str(j) + ','
eid=a
filename = (str("log" + '.csv'))

# createss the log file (csv) and appends the input data.
fd = open(dir + '\\' + filename,'a')
fd.write(str(eid))
fd.close()

OUT = a
# ----------------------------------------
watch_157 = Watch(element_selection_logger)
element_selection_logger_2 = Python(IN[0]=watch_153, IN[1]=csv_directory_path, IN[2]=watch_157)
# ---------- element_selection_logger_2.python (39 lines) ----------
# Original Script by EwanO 2018 (Sastrugi Package) 
# Use as you like :-)
# This code creates and appends items to a CSV file on the Desktop that
# lists elements fed to the input.

import clr
import System
from System.IO import Directory

import sys
# load python
#pyt_path = r'C:\Program Files (x86)\IronPython.2.7.8\Lib'
#sys.path.append(pyt_path)

#import os

## set the output directory and gather log data
#main_dir = 'C:\\Users'
#user = os.environ.get('USERNAME')
#dir = main_dir + '\\' + user + '\\Desktop'
dir = IN[1]
# generate the file name for the log file
a = ''
b=IN[2]
for i in IN[0]:
	for j in i:
		if i.index(j) == len(i)-1:
			a= a + str(j) + '\n'
		else:
			a= a + str(j) + ','
eid=a
filename = (str("log" + '.csv'))

# createss the log file (csv) and appends the input data.
fd = open(dir + '\\' + filename,'a')
fd.write(str(eid))
fd.close()

OUT = a
# ----------------------------------------
watch_158 = Watch(element_selection_logger_2)
element_selection_logger_3 = Python(IN[0]=watch_150, IN[1]=csv_directory_path, IN[2]=watch_158)  # same code as element_selection_logger_2
watch_159 = Watch(element_selection_logger_3)
element_selection_logger_4 = Python(IN[0]=watch_149, IN[1]=csv_directory_path, IN[2]=watch_159)  # same code as element_selection_logger_2
watch_160 = Watch(element_selection_logger_4)
element_selection_logger_5 = Python(IN[0]=watch_148, IN[1]=csv_directory_path, IN[2]=watch_160)  # same code as element_selection_logger_2
watch_161 = Watch(element_selection_logger_5)
element_selection_logger_6 = Python(IN[0]=watch_147, IN[1]=csv_directory_path, IN[2]=watch_161)
# ---------- element_selection_logger_6.python (39 lines) ----------
# Original Script by EwanO 2018 (Sastrugi Package) 
# Use as you like :-)
# This code creates and appends items to a CSV file on the Desktop that
# lists elements fed to the input.

import clr
import System
from System.IO import Directory

import sys
# load python
#pyt_path = r'C:\Program Files (x86)\IronPython.2.7.8\Lib'
#sys.path.append(pyt_path)

#import os

## set the output directory and gather log data
#main_dir = 'C:\\Users'
#user = os.environ.get('USERNAME')
#dir = main_dir + '\\' + user + '\\Desktop'
dir = IN[1]
# generate the file name for the log file
a = ''
b= IN[2]
for i in IN[0]:
	for j in i:
		if i.index(j) == len(i)-1:
			a= a + str(j) + '\n'
		else:
			a= a + str(j) + ','
eid=a
filename = (str("log" + '.csv'))

# createss the log file (csv) and appends the input data.
fd = open(dir + '\\' + filename,'a')
fd.write(str(eid))
fd.close()

OUT = a
# ----------------------------------------
watch_162 = Watch(element_selection_logger_6)
the_log = Output(element_selection_logger_6)
