# Dynamo graph ifc compare 2018-no Custome Node-multiIFCfiles.dyn (Dynamo 1.3.2.2480)

# group: reading from IFC files directory
now = DateTime.Now()
directory_path = Directory("C:\Users\umroot\Desktop\IFCexports")
code_block = CodeBlock(DirectoryPath=directory_path) { DirectoryPath; }
fromPath = DirectoryObject(code_block)  # "Directory.FromPath"
contents = Directory.Contents(fromPath)

# group: IFC logging for two ifc files
boolean = BoolSelector(true)
code_block_2 = CodeBlock(directory=directory_path) { directory + "\\Element_log.csv"; }
watch = Watch(code_block_2)
fromPath_2 = FileObject(watch)  # "File.FromPath"
readFromFile = CSV.ReadFromFile(fromPath_2)
export_ifc_differences_into = Custom[export ifc differences into excel2](All_Activities=boolean, All_Activities_2=boolean, selected_elements_csv=readFromFile)  # export ifc differences into excel; unwired: index_new, list, csv_directory_path, index_old
type = Object.Type(code_block_2)
watch_2 = Watch(type)

# group: indices of IFC files in the directory
watch_3 = Watch(contents)
python_script = Python(IN[0]=watch_3)
# ---------- python_script.python (12 lines) ----------
import clr
clr.AddReference('ProtoGeometry')
from Autodesk.DesignScript.Geometry import *
#The inputs to this node will be stored as a list in the IN variables.
dataEnteringNode = IN

#Assign your output to the OUT variable.
OUT = []
for i in IN[0]:
	if "log" not in i and "Log" not in i:
		OUT.append(i)
	
# ----------------------------------------
sort = Python(IN[0]=python_script)
# ---------- sort.python (13 lines) ----------
# lingkonn@gmail.com

x=IN[0]
import re
def sort(x): 
    convertText = lambda text: int(text) if text.isdigit() else text.lower() 
    Textkey = lambda key: [ convertText(c) for c in re.split('([0-9]+)', key) ] 
    return sorted(x, key = Textkey)
a = sort(x)
OUT=[]
for i in a:
	if 'log.' not in i:
		OUT.append(i)
# ----------------------------------------
watch_4 = Watch(sort)
watch_5 = Watch(watch_4)
count = List.Count(watch_5)
code_block_3 = CodeBlock(count=count) { 1..count-1..1; }

watch_6 = Watch(code_block_3)

# group: Loop for IFC logging over the archive
code_block_4 = CodeBlock(export_ifc_differences_into, arg2=watch_5, arg3=directory_path, arg4=watch_6)  # unwired: arg1
# ---------- code_block_4.designscript (12 lines) ----------
xlexp;
indexnew;
ifclist;
CsvDirPath;

countlist;

[Imperative]
{
for (indexnew in countlist)
 y= xlexp.DoEvaluation(indexnew).DoEvaluation(ifclist).DoEvaluation(CsvDirPath).DoEvaluation(indexnew-1);
};
# ----------------------------------------

export_ifc_differences_into_2 = Custom[export ifc differences into excel-info]()  # export ifc differences into excel; unwired: index_new, list, file_path_of_the_exported_excel, index_old, All_Activities, All_Activities_2
export_ifc_differences_into_3 = Custom[export ifc differences into excel-add remove rotation relocation]()  # export ifc differences into excel; unwired: index_new, list, file_path_of_the_exported_excel, index_old, selected_elements_csv
export_ifc_differences_into_4 = Custom[export ifc differences into excel-add remove]()  # export ifc differences into excel; unwired: index_new, list, file_path_of_the_exported_excel, index_old
file_path = Filename("..\..\..\..\..\Users\umroot\Desktop\xxx")
